# Grasshopper definition engrenage_grasshopper.gh (Grasshopper 1.0.8)

number_slider = Slider(12.777, range=0..50)
cir = Circle(Plane=PlaneXY(0, 0, 0), Radius=Slider(10, range=0..10))
cir_2 = Circle(Plane=PlaneXY(0, 0, 0), Radius=Slider(3.243, range=1..6))
cir_3 = Circle(Plane=PlaneXY(0, 0, 0), Radius=Slider(8, range=0..8))
divide = DivideCurve(Curve=cir_3, Count=number_slider, Kinks=False)  # -> Points, Tangents, Parameters
divide_2 = DivideCurve(Curve=cir, Count=number_slider, Kinks=False)  # -> Points, Tangents, Parameters
weave = Weave(Pattern=[0, 1], Stream0=divide_2.Points, Stream1=divide.Points, NullGaps=False)
pline = PolyLine(Vertices=weave, Closed=invert(False))
fillet = FilletDistance(Curve=pline, Distance=Slider(0.321, range=0..1))
boundary = BoundarySurfaces(Edges=flatten([fillet, cir_2]))
Z = UnitZ(Factor=Slider(3.511, range=0.1..5))
extr = Extrude(Base=boundary, Direction=Z)
cap = CapHoles(Brep=extr)
preview = CustomPreview(Geometry=cap, Material=ColourSwatch(SwatchColor=RGB(0, 88, 255)))
